# Grasshopper definition AgentBased.gh (Grasshopper 0.9.76)
# plug-ins: Crow

inputsrf = Surface(reparameterize(<surface referenced from the Rhino model>))

# ----
# Generate Flow Lines
number_slider = Slider(100, range=0..200)
range = Range(Domain=Domain(0, 1), Steps=number_slider)
pt = ConstructPoint(XCoordinate=range, YCoordinate=graft(range), ZCoordinate=0)  # -> simplify(Point)
evalsrf = EvaluateSurface(Surface=inputsrf, Point=pt)  # -> Point, Normal, Frame
Z = UnitZ(Factor=-1)
line = LineSDL(Start=evalsrf.Point, Direction=Z, Length=Slider(0.559, range=0..3))
pt_2 = ConstructPoint(XCoordinate="1.0", YCoordinate="0.0", ZCoordinate=0)
pt_3 = ConstructPoint(XCoordinate="0.0", YCoordinate="1.0", ZCoordinate=0)
pt_4 = ConstructPoint(XCoordinate="0.0", YCoordinate="0.0", ZCoordinate=0)
pt_5 = ConstructPoint(XCoordinate="1.0", YCoordinate="1.0", ZCoordinate=0)
project = Project(Geometry=line, Plane=evalsrf.Frame)  # -> Geometry, Transform
end = EndPoints(Curve=project.Geometry)  # -> Start, End
srf4pt = _4PointSurface(CornerA=pt_4, CornerB=pt_3, CornerC=pt_5, CornerD=pt_2)
srf_cp = SurfaceClosestPoint(Point=end.End, Surface=inputsrf)  # -> Point, UVPoint, Distance
evalsrf_2 = EvaluateSurface(Surface=srf4pt, Point=srf_cp.UVPoint)  # -> Point, Normal, Frame
evalsrf_3 = EvaluateSurface(Surface=srf4pt, Point=pt)  # -> Point, Normal, Frame
ln = Line(StartPoint=evalsrf_2.Point, EndPoint=evalsrf_3.Point)

# ----
# RESET
button = Button()

# ----
# Wandering
number_slider_2 = Slider(0.8, range=0..1)
c_script = CSharpScript(
    stepLength=Slider(0.02, range=0..0.1),
    range=Slider(3.14, range=0..6.28),
    VectorFieldLines=flatten(ln),
    slopeWeight=number_slider_2,
    reset=button)  # -> out, u, v, s, r, M, bump; inputs stepLength: Double, range: Double, VectorFieldLines: list of Line, slopeWeight: Double, reset: Boolean
# ---------- c_script: C# ----------
    string filePathBool = GrasshopperDocument.FilePath;
    filePathBool = filePathBool.Substring(0, filePathBool.LastIndexOf(@"\"));
    filePathBool += @"\boolGoUp.txt";
    if (reset)
    {
      rnd = new Random();
      posUV = new Point3d(rnd.NextDouble(), rnd.NextDouble(), 0.0);
      rand = new Vector3d(1.0, 0.0, 0.0);
      slope = new Vector3d(0.0, 0.0, 0.0);
      vf = new VectorField(VectorFieldLines);
      if(!System.IO.File.Exists(filePathBool))
        System.IO.File.Create(filePathBool);
      System.IO.File.WriteAllText(filePathBool, "True");
    }



    else
    {

      slope = FindClosestFieldVector(posUV);

      if (File.ReadAllText(filePathBool) == "True") inverse = 1;
      else inverse = -1;
      slope *= inverse;
      rand = rotateRandom(slope, range);

      Vector3d tmpMoveVec = new Vector3d(0.0, 0.0, 0.0);
      rand *= slope.Length;
      moveVec.X = rand.X * (1 - slopeWeight) + slope.X * slopeWeight;
      moveVec.Y = rand.Y * (1 - slopeWeight) + slope.Y * slopeWeight;
      moveVec.Z = rand.Z * (1 - slopeWeight) + slope.Z * slopeWeight;
      moveVec.Unitize();
      moveVec *= stepLength;

      r = rand;
      s = slope;
      M = moveVec;

      if (!((posUV.X > stepLength || moveVec.X > 0.0) &&
        (posUV.Y > stepLength || moveVec.Y > 0.0) &&
        (posUV.X < 1.0 - stepLength || moveVec.X < 0.0) &&
        (posUV.Y < 1.0 - stepLength || moveVec.Y < 0.0)
        ))
      {
        range = 2 * Math.PI;
        Rhino.RhinoApp.WriteLine("bump!");
        bump = true;
      }
      else
      {
        //moveVec = tmpMoveVec;
        posUV += moveVec;

        Rhino.RhinoApp.WriteLine("no bump!");
        bump = false;
      }

      u = posUV.X;
      v = posUV.Y;
    }
# ---------- c_script: C# additional code ----------
  Point3d posUV = new Point3d(0.5, 0.5, 0.0);
  Vector3d rand = new Vector3d(1.0, 0.0, 0.0);
  Vector3d slope = new Vector3d(0.0, 0.0, 0.0);
  Vector3d moveVec = new Vector3d(0.0, 0.0, 0.0);

  int inverse = 1;

  VectorField vf = new VectorField();

  Vector3d vec = new Vector3d(1.0, 0.0, 0.0);
  Random rnd = new Random();
  double rndNr = 0.0;


  public Vector3d rotateRandom(Vector3d vectorToRotate, double range)
  {
    rndNr = rnd.NextDouble() * range - range * 0.5;
    vectorToRotate.Rotate(rndNr, Vector3d.ZAxis);
    vectorToRotate.Unitize();
    return vectorToRotate;
  }


  public Vector3d FindClosestFieldVector(Point3d currentPosUV)
  {
    int index = 0;
    for (int i = 0; i < vf.PosUV.Count; i++) if (currentPosUV.DistanceTo(vf.PosUV[i]) < currentPosUV.DistanceTo(vf.PosUV[index])) index = i;
    try
    {
      Vector3d vu = vf.UpVec[index];
      vu.Unitize();
      return vu;
    }
    catch { };
    return new Vector3d(0.0, 0.0, 0.0);
  }


  public class VectorField
  {
    public List<Point3d> PosUV = new List<Point3d>();
    public List<Vector3d> UpVec = new List<Vector3d>();

    public VectorField()
    {
      this.PosUV = new List<Point3d>();
      this.UpVec = new List<Vector3d>();
    }

    public VectorField(List<Line> lines)
    {
      PosUV = new List<Point3d>();
      UpVec = new List<Vector3d>();

      double length = 0.0;
      for (int i = 0; i < lines.Count; i++)
      {
        length = Math.Max(length, lines[i].Length);
        PosUV.Add(lines[i].From);
        UpVec.Add(new Vector3d(lines[i].To - lines[i].From));
      }

      for (int i = 0; i < lines.Count; i++) UpVec[i] /= length;
    }
  }
# ---------- end c_script ----------
number_slider_3 = Slider(0.05, range=0..1)
pt_6 = ConstructPoint(XCoordinate=c_script.u, YCoordinate=c_script.v, ZCoordinate=0)
multiplication = Multiplication(A=c_script.s, B=number_slider_3)
multiplication_2 = Multiplication(A=c_script.r, B=number_slider_3)
evalsrf_4 = EvaluateSurface(Surface=inputsrf, Point=pt_6)  # -> Point, Normal, Frame
addition = Addition(A=pt_6, B=multiplication)
addition_2 = Addition(A=pt_6, B=c_script.M)
addition_3 = Addition(A=pt_6, B=multiplication_2)
evalsrf_5 = EvaluateSurface(Surface=inputsrf, Point=[addition, addition_3, addition_2])  # -> Point, Normal, Frame
vec2pt = Vector2Pt(PointA=evalsrf_4.Point, PointB=evalsrf_5.Point, Unitize=False)  # -> Vector, Length

# ----
# On/Off
timer = Timer(TimerInterval=1, Target=c_script)  # disabled

# ----
# History
rec = DataRecorder(evalsrf_4.Point, DataLimit=-20, RecordData=True)
pline = PolyLine(Vertices=rec, Closed=False)
preview = CustomPreview(Geometry=pline, Shader=ColourSwatch(SwatchColor=RGB(41, 41, 41)))

# ----
# Visualization
swatch = ColourSwatch(SwatchColor=RGB(98, 0, 255))
item = ListItem(List=vec2pt.Vector, Index=0, Wrap=True)  # -> Item, Item1, Item2
vdisex = VectorDisplayEx(Point=evalsrf_4.Point, Vector=item.Item2, Colour=swatch, Width=5)
vdis = VectorDisplay(Anchor=evalsrf_4.Point, Vector=item.Item)
vdis_2 = VectorDisplay(Anchor=evalsrf_4.Point, Vector=item.Item1)

# ----
# -> Right Click
# -> Load Network
# -> valleyedNet.cnw
crow_bp = CrowEngineBackpropagation(Cycles=1000)  # -> MeanSquareError, Network

# ----
# -> Right Click
# -> Load Network
# -> bumpNet.cnw
crow_bp_2 = CrowEngineBackpropagation(Cycles=1000)  # -> MeanSquareError, Network

# ----
# Recognize
# Situation
unit = UnitVector(Vector=c_script.M)
unit_2 = UnitVector(Vector=c_script.M)
pdecon = Deconstruct(Point=unit)  # -> XComponent, YComponent, ZComponent
pdecon_2 = Deconstruct(Point=unit_2)  # -> XComponent, YComponent, ZComponent
eval = Evaluate(F="y * 0.5 + 0.5", y=pdecon.XComponent)
eval_2 = Evaluate(F="y * 0.5 + 0.5", y=pdecon.YComponent)
merge = Merge(Data1=c_script.u, Data2=c_script.v, Data3=pdecon_2.XComponent, Data4=pdecon_2.YComponent)
weave = Weave(Pattern=[0, 1], Stream0=eval, Stream1=eval_2, NullGaps=False)
rec_2 = DataRecorder(merge, DataLimit=16, RecordData=True)
rec_3 = DataRecorder(weave, DataLimit=30, RecordData=True)
bp_vc_valleyed = BackpropagationVectorClassifier(CrowNet=crow_bp.Network, InputVector=rec_3)
bp_vc_bumped = BackpropagationVectorClassifier(CrowNet=crow_bp_2.Network, InputVector=rec_2)
writetotxt = CSharpScript(threshold=Slider(0.2, range=0..1), VALLEY=bp_vc_valleyed, BUMP=bp_vc_bumped)  # -> out, valleyed, bumped; inputs threshold: Double, VALLEY: list of Double, BUMP: list of Double
# ---------- writetotxt: C# ----------
    bool bv = false;
    bool bb = false;
    if(memDecay == 15 && curlingDetected(VALLEY[0], VALLEY[1], threshold) && System.IO.File.ReadAllText(@"C:\boolGoUp.txt") == "False")
    {
      System.IO.File.WriteAllText(@"C:\boolGoUp.txt", "True");
      bv = true;
      if(memDecay == 15) memDecay--;
    }
    else if(memDecay == 15 && curlingDetected(VALLEY[0], VALLEY[1], threshold) && System.IO.File.ReadAllText(@"C:\boolGoUp.txt") == "True")
    {
      System.IO.File.WriteAllText(@"C:\boolGoUp.txt", "False");
      bv = true;
      if(memDecay == 15) memDecay--;
    }
    else if(memDecay == 15 && curlingDetected(BUMP[0], BUMP[1], threshold) && System.IO.File.ReadAllText(@"C:\boolGoUp.txt") == "False")
    {
      System.IO.File.WriteAllText(@"C:\boolGoUp.txt", "True");
      bb = true;
      if(memDecay == 15) memDecay--;
    }
    else if(memDecay == 15 && curlingDetected(BUMP[0], BUMP[1], threshold) && System.IO.File.ReadAllText(@"C:\boolGoUp.txt") == "True")
    {
      System.IO.File.WriteAllText(@"C:\boolGoUp.txt", "False");
      bb = true;
      if(memDecay == 15) memDecay--;
    }

    if(memDecay == 0) memDecay = 15;
    if(memDecay < 15) memDecay--;
    valleyed = bv;
    bumped = bb;
# ---------- writetotxt: C# additional code ----------
  bool curlingDetected(double A, double B, double Threshold)
  {
    if(A < (1 - Threshold) && B > Threshold) return true;
    return false;
  }

  int memDecay = 15;
# ---------- end writetotxt ----------

# ----
# A white or red sphere
# will show up, when the
# respective situation is
# detected
dispatch = Dispatch(List=evalsrf_4.Point, DispatchPattern=writetotxt.bumped)  # -> ListA, ListB
dispatch_2 = Dispatch(List=evalsrf_4.Point, DispatchPattern=writetotxt.valleyed)  # -> ListA, ListB
sph = Sphere(Base=dispatch.ListA, Radius=0.5)
sph_2 = Sphere(Base=dispatch_2.ListA, Radius=0.5)
preview_2 = CustomPreview(Geometry=sph, Shader=ColourSwatch(SwatchColor=RGB(255, 0, 0)))
preview_3 = CustomPreview(Geometry=sph_2, Shader=ColourSwatch(SwatchColor=RGB(255, 255, 255)))
