# Grasshopper definition TrainingData.gh (Grasshopper 0.9.76)

# ----
# Data Valley Peak
# structure:
# - chunk size 30
# - last 15 steps of moveVec recorded
# - uvuvuvuvuvuvuvuvuvuvuvuvuvuvuv
number_slider = Slider(0.001, range=0.001..1)
number_slider_2 = Slider(0.85, range=0..1)
number_slider_3 = Slider(0.999, range=0..0.999)
randomergood = Number([0.3953909093, 0.9889344927, 0.1259648985, 0.8318097992, 0.2570893095, 0.9370290568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])
straightgood = Number([0.5256753807, 0.9993403397, 0.5033727815, 0.9999886242, 0.5567695518, 0.9967667642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])
topbad = Number([0.9188036701, 0.7731363871, 0.7493891913, 0.9333647785, 0.9987539021, 0.5352781112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])
subtraction = Subtraction(A=1, B=number_slider_3)
subtraction_2 = Subtraction(A=1, B=number_slider)
subtraction_3 = Subtraction(A=1, B=number_slider_2)
nullrep = ReplaceNulls(Items=straightgood, Replacements=0.5)  # -> Items, Count
merge = Merge(Data1=flatten(topbad), Data2=flatten(randomergood), Data3=flatten(nullrep.Items))
dup = DuplicateData(Data=number_slider, Number=110, Order=True)  # -> simplify(Data)
dup_2 = DuplicateData(Data=subtraction_2, Number=110, Order=True)  # -> simplify(Data)
dup_3 = DuplicateData(Data=number_slider_3, Number=220, Order=True)  # -> simplify(Data)
dup_4 = DuplicateData(Data=subtraction, Number=220, Order=True)  # -> simplify(Data)
dup_5 = DuplicateData(Data=subtraction_3, Number=220, Order=True)  # -> simplify(Data)
dup_6 = DuplicateData(Data=number_slider_2, Number=220, Order=True)  # -> simplify(Data)
partition = PartitionList(List=merge, Size=30)  # -> simplify(Chunks)
weave = Weave(Pattern=[0, 1], Stream0=dup, Stream1=dup_2, NullGaps=False)
weave_2 = Weave(Pattern=[0, 1], Stream0=dup_6, Stream1=dup_5, NullGaps=False)
weave_3 = Weave(Pattern=[0, 1], Stream0=dup_3, Stream1=dup_4, NullGaps=False)
merge_2 = Merge(Data1=flatten(weave), Data2=flatten(weave_2), Data3=flatten(weave_3))
partition_2 = PartitionList(List=merge_2, Size=2)  # -> simplify(Chunks)
traininpeakvalley = Number(partition)
trainoutpeakvalley = Number(partition_2)

# ----
# deleting every fourth tree
# and merging
# Cleaning Nulls by deleting trees
# containing nulls
# Data Bumps
# structure:
# - chunk size 16
# - last 4 steps of PosUV and moveVec recorded
# - PosU,  PosV, VecU, VecV
# trainOut data:
# vector[2]
# bump: 1, 0
# no bump: 0, 1
dom = ConstructDomain(DomainStart=0, DomainEnd=91775)
nobumpraw_c16 = Number([0.5146219092, 0.004426755323, -0.2485998293, -0.9686062796, 0.5146219092, 0.004426755323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])
bumpraw_c16 = Number([0.9412423007, 0.9947658107, 0.6393779021, 0.7688926442, 0.9412423007, 0.9947658107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])
number_slider_4 = Slider(0.001, range=0.001..1)
subset = SubList(List=nobumpraw_c16, Domain=dom, Wrap=True)  # -> List, Index
partition_3 = PartitionList(List=bumpraw_c16, Size=16)  # -> simplify(Chunks)
partition_4 = PartitionList(List=subset.List, Size=16)  # -> simplify(Chunks)
subtraction_4 = Subtraction(A=1, B=number_slider_4)
clean = CleanTree(RemoveNulls=True, RemoveInvalid=True, RemoveEmpty=False, Tree=partition_4)
dup_7 = DuplicateData(Data=number_slider_4, Number=655, Order=True)  # -> simplify(Data)
dup_8 = DuplicateData(Data=subtraction_4, Number=655, Order=True)  # -> simplify(Data)
dup_9 = DuplicateData(Data=number_slider_4, Number=1401, Order=True)  # -> simplify(Data)
dup_10 = DuplicateData(Data=subtraction_4, Number=1401, Order=True)  # -> simplify(Data)
lng = ListLength(List=partition_4)
lng_2 = ListLength(List=clean)
weave_4 = Weave(Pattern=[0, 1], Stream0=dup_7, Stream1=dup_8, NullGaps=False)
weave_5 = Weave(Pattern=[0, 1], Stream0=dup_10, Stream1=dup_9, NullGaps=False)
equals = Equality(FirstNumber=flatten(lng), SecondNumber=flatten(lng_2))  # -> Equality, Inequality
merge_3 = Merge(Data1=weave_4, Data2=weave_5)
partition_5 = PartitionList(List=merge_3, Size=2)  # -> simplify(Chunks)
dispatch = Dispatch(List=partition_4, DispatchPattern=simplify(graft(equals.Equality)))  # -> ListA, ListB
panel = Panel(partition_5)
clean_2 = CleanTree(RemoveNulls=True, RemoveInvalid=True, RemoveEmpty=True, Tree=dispatch.ListA)
flip = FlipMatrix(Data=clean_2)
flip_2 = FlipMatrix(Data=flip)
nobumpcleaned = Number(flip_2)
bumpcleaned = Number(partition_3)
c_script = CSharpScript(x=nobumpcleaned)  # -> out, A; inputs x: tree of Double
# ---------- c_script: C# ----------
    int counter = 0;
    DataTree<double> newTree = new DataTree<double>();
    for(int i = 0; i < x.BranchCount; i++)
    {
      if(i % 4 == 0)
      {
        for(int j = 0; j < x.Branches[i].Count; j++)
          newTree.Add(x.Branches[i][j], new GH_Path(counter));
        counter++;
      }
    }
    A = newTree;
# ---------- end c_script ----------
c_script_2 = CSharpScript(x=bumpcleaned)  # -> out, A; inputs x: tree of Double; same code as c_script
merge_4 = Merge(Data1=flatten(c_script_2.A), Data2=flatten(c_script.A))
partition_6 = PartitionList(List=merge_4, Size=16)  # -> simplify(Chunks)
