# Grasshopper definition Neural_sensing.gh (Grasshopper 0.9.76)
# plug-ins: Firefly.X, FlexHopper, Weaverbird, Crow, Firefly.Core

video_stream = WebCamVideoStream()

# ----
# Sensor Input
ports_available = COMPortsAvailable()
list = ValueList({"0", "1"}, selected="1")
panel = Panel(ports_available)
item = ListItem(List=panel, Index=list, Wrap=True)
list_2 = ValueList({"2400", "4800", "9600", "14400", "19200", "28800", "38400", "57600", "115200"}, selected="9600")
open_port = OpenClosePort(OpenClosePort=Toggle(True), PortNumber=item, BaudRate=list_2)
uno_read = UnoRead(StartReadingValues=Toggle(True), PortNumber=item)  # -> AnalogPin0, AnalogPin1, AnalogPin2, AnalogPin3, AnalogPin4, AnalogPin5, DigitalPin2, DigitalPin4, DigitalPin7, StatusMessage
panel_2 = Panel([uno_read.AnalogPin3, uno_read.AnalogPin4, uno_read.AnalogPin5])
panel_3 = Panel(uno_read.AnalogPin0)

timer = Timer(TimerInterval=100, Target=[uno_read, graft])  # disabled
button = Button()
analyse = AnalyseData(Data=panel_2)  # -> ArithmeticMean, GeometricMean, Minimum, Maximum, Range, Variance, StandardDeviation, VectorLength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
division = Division(A=uno_read.AnalogPin0, B=1024)
# Training In (sensors)
# {0} [N = 4]
# sample 0
# {1} [N = 4]
# sample 1
# {2} [N = 3]
# {2} [N = 4]
# sample 2
# {3} [N = 3]
# {3} [N = 4]
# sample 3
# {4} [N = 3]
# {4} [N = 4]
# sample 4
panel_4 = Panel("https://github.com/HeinzBenjamin/Crow")
merge = Merge(Data1=flatten(division), Data2=flatten(analyse.Scaled))

# ----
# Data
# pre-processing
panel_5 = Panel("1024")
analyse_2 = AnalyseData()  # -> ArithmeticMean, GeometricMean, Minimum, Maximum, Range, Variance, StandardDeviation, VectorLength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
division_2 = Division(B=panel_5)
panel_6 = Panel(analyse_2.Scaled)
panel_7 = Panel(analyse_2.Normalized)
panel_8 = Panel(analyse_2.NormalizedSoftmax)
panel_9 = Panel(division_2)
panel_10 = Panel([analyse_2.ArithmeticMean, analyse_2.GeometricMean, analyse_2.Minimum, analyse_2.Maximum, analyse_2.Range, analyse_2.Variance, analyse_2.StandardDeviation, analyse_2.VectorLength])
panel_11 = Panel(analyse_2.Softmax)
panel_12 = Panel(analyse_2.ScaledSoftmax)

panel_13 = Panel(merge)
clean = CleanTree(RemoveNulls=True, RemoveInvalid=True, RemoveEmpty=False, Tree=merge)
graft = GraftTree(
    Tree=[Slider(1, range=0..1), Slider(0, range=0..1), Slider(0, range=0..1)],
    IncludeEmptyLists=True,
    IncludeNullItems=True)
graft_2 = GraftTree(Tree=clean, IncludeEmptyLists=True, IncludeNullItems=True)

# ----
# Construct Network
panel_14 = Panel("""0
1""")
panel_15 = Panel("""5
6""")
backprop = CrowNetConstructorBackpropagationNetwork(LayerStructure=panel_14, NeuronCount=panel_15, LearningRate=0.2)

# ----
# Training Out (model parameters)
rec = DataRecorder(graft, DataLimit=-10, RecordData=False)
rec_2 = DataRecorder(graft_2, DataLimit=-10, RecordData=False)
flip = FlipMatrix(Data=rec_2)
# {0} [N = 3]
# {1} [N = 3]
flip_2 = FlipMatrix(Data=rec)

# ----
# Train Network
crow_bp = CrowEngineBackpropagation(Cycles=1000)  # -> MeanSquareError, Network

bp_vc = BackpropagationVectorClassifier(CrowNet=crow_bp.Network, InputVector=merge)
item_2 = ListItem(List=bp_vc, Index=0, Wrap=True)  # -> Item, Item1, Item2

parametera = Number(item_2.Item)
parameterb = Number(item_2.Item1)
parameterc = Number(item_2.Item2)

# ----
# Parametric model
panel_16 = Panel("8")
multiplication = Multiplication(A=parametera, B=panel_16)
multiplication_2 = Multiplication(A=parameterb, B="4")
int = Integer(expr("x*1.6", multiplication))
int_2 = Integer(multiplication_2)
pt = ConstructPoint(XCoordinate=0, YCoordinate=expr("x*4", "5"), ZCoordinate=0)
pt_2 = ConstructPoint(XCoordinate=0, YCoordinate=0, ZCoordinate="8")
pt_3 = ConstructPoint(XCoordinate=0, YCoordinate="10", ZCoordinate=int)
range = Range(Domain=Domain(0, 6.283185307), Steps=expr("x+3", int_2))
nurbs = NurbsCurve(Vertices=flatten([pt_2, pt_3, pt]), Degree=3, Periodic=False)  # -> Curve, Length, Domain
rotate = Rotate(Geometry=nurbs.Curve, Angle=range, Plane=PlaneXY(0, 0, 0))  # -> Geometry, Transform
end = EndPoints(Curve=rotate.Geometry)  # -> Start, End
lng = ListLength(List=rotate.Geometry)
project = Project(Geometry=end.End, Plane=end.Start)  # -> Geometry, Transform
range_2 = Range(Domain=Domain(0, 1), Steps=expr("x-1", lng))
vec2pt = Vector2Pt(PointA=end.Start, PointB=project.Geometry, Unitize=False)  # -> Vector, Length
pl = PlaneNormal(Origin=end.Start, ZAxis=vec2pt.Vector)
graph = GraphMapper(range_2, x0=0, x1=1, y0=1, y1=3, container_name="Bezier", cpx=[0, 0.9897567034, 0, 1], cpy=[0, 0.9898955822, 1, 0])
graph_2 = GraphMapper(
    parameterc,
    x0=0,
    x1=1,
    y0=1,
    y1=14,
    container_name="Bezier",
    cpx=[0, 0.2211188674, 1, 1],
    cpy=[0, 0.5418356061, 0.416403532, 1])
scale_nu = ScaleNU(Geometry=rotate.Geometry, Plane=pl, ScaleX=1, ScaleY=1, ScaleZ=graph)  # -> Geometry, Transform
shift = ShiftList(List=scale_nu.Geometry, Shift=1, Wrap=True)
custom_mesh_settings = SettingsCustom(
    StitchSeams=True,
    SimplePlanes=False,
    Refine=True,
    MinCount=16,
    MaxCount=400,
    AspectRatio=1,
    MaxDistance=0,
    MaxAngle=90,
    MinEdge=1,
    MaxEdge=graph_2)
graft_3 = GraftTree(Tree=scale_nu.Geometry, IncludeEmptyLists=True, IncludeNullItems=True)  # -> simplify(Tree)
graft_4 = GraftTree(Tree=shift, IncludeEmptyLists=True, IncludeNullItems=True)  # -> simplify(Tree)
ext = ExtendCurve(Curve=scale_nu.Geometry, Type=1, Start=0, End=5)
loft = Loft(
    Curves=[graft_3, graft_4],
    Options={Adjust=False, Closed=False, LoftEnds=0, LoftSimp=0, LoftType=0, Rebuild=10, Refit=0.01})
panel_17 = Panel("""0.0
1.0""")
panel_18 = Panel("""1.4
0.3""")
mesh = MeshBrep(Brep=loft, Settings=custom_mesh_settings)  # -> flatten(Mesh)
vpipe = PipeVariable(Curve=reparameterize(simplify(graft(ext))), Parameters=panel_17, Radii=panel_18, Caps=2)
clean_2 = CleanTree(RemoveNulls=True, RemoveInvalid=True, RemoveEmpty=False, Tree=mesh)
tri = Triangulate(Mesh=clean_2)  # -> Mesh, Count
wbdual = WeaverbirdsDualGraph(MeshCurves=tri.Mesh, DualMode=0)
wbcarpet = WeaverbirdsSierpinskiCarpet(MeshPolylines=wbdual, Distance=15, InsetType=0)
geo = Geometry(flatten([vpipe, wbcarpet]))
bake = InstantBake(Objects=flatten(geo), LayerName="Default", MaterialName="Default material", ClearLayer=False)  # disabled
