# Grasshopper definition 160523_Crow_Showcase_KohonenND.gh (Grasshopper 0.9.76)
# Copyright: Benjamin Felbrich
# plug-ins: Crow

# ----
# - create input vectors
# - build parametric model from input
#   vectors (in this case: colored cubes)
number_slider = Slider(2183, range=0..5555)
random = Random(Range=Domain(0, 10), Number="20", Seed=expr("x+1", number_slider))
random_2 = Random(Range=Domain(0, 10), Number="20", Seed=expr("x+2", number_slider))
random_3 = Random(Range=Domain(-1, 1), Number="20", Seed=expr("x+3", number_slider))
random_4 = Random(Range=Domain(-1, 1), Number="20", Seed=expr("x+4", number_slider))
random_5 = Random(Range=Domain(-1, 1), Number="20", Seed=expr("x+5", number_slider))
random_6 = Random(Range=Domain(-1, 1), Number="20", Seed=expr("x+6", number_slider))
random_7 = Random(Range=Domain(-1, 1), Number="20", Seed=expr("x+7", number_slider))
random_8 = Random(Range=Domain(-1, 1), Number="20", Seed=expr("x+9", number_slider))
random_9 = Random(Range=Domain(0.05, 0.4), Number="20", Seed=expr("x+8", number_slider))
random_10 = Random(Range=Domain(0, 1), Number="20", Seed=expr("x+11", number_slider))
random_11 = Random(Range=Domain(0, 10), Number="20", Seed=number_slider)
entwine = Entwine(
    Branch00=random_11,
    Branch01=random,
    Branch02=random_2,
    Branch03=random_3,
    Branch04=random_4,
    Branch05=random_5,
    Branch06=random_6,
    Branch07=random_7,
    Branch08=random_8,
    Branch09=random_9,
    Branch010=random_10,
    FlattenInputs=True)  # -> simplify(Result)
vec = VectorXYZ(XComponent=random_6, YComponent=random_7, ZComponent=random_8)  # -> unitize(Vector), Length
vec_2 = VectorXYZ(XComponent=random_3, YComponent=random_4, ZComponent=random_5)  # -> unitize(Vector), Length
pt = ConstructPoint(XCoordinate=random_11, YCoordinate=random, ZCoordinate=random_2)
hsl = ColourHSL(Alpha=1, Hue=random_10, Saturation=1, Luminance=0.5)
pl = ConstructPlane(Origin=pt, XAxis=vec_2.Vector, YAxis=vec.Vector)
box = CenterBox(Base=pl, X=random_9, Y=random_9, Z=random_9)

# ----
# Create neural network topology
toggle = BooleanToggle(False)
panel = Panel("""5
7
4
4""")
som_g = CrowNetConstructorSelfOrganizingMapGeneric(LayerDimensions=panel, NeighborhoodFunction=toggle, LearningRate=Slider(0.2, range=0..1))

preview = CustomPreview(Geometry=box, Shader=hsl)

flip = FlipMatrix(Data=entwine)

# ----
# Run!
toggle_2 = BooleanToggle(False)
crow_som_g = CrowEngineSelfOrganizingMapsGeneric(TrainingCycles="5000", CrowNetSOMG=som_g, TrainingVectors=flip, Start=toggle_2)  # -> TrainingCycles, CrowNet
panel_2 = Panel(crow_som_g.TrainingCycles)

panel_3 = Panel("""0
1
2""")

# ----
# Draw network chosen connections
number_slider_2 = Slider(0, range=0..1)
panel_4 = Panel("""0
1
2""")
som_g_grid = GenericSOMGridDisplay(
    CrowNet=crow_som_g.CrowNet,
    XYZDimensionIndicesOptional=panel_3,
    TopologyDimensionIndicesOptional=panel_4,
    RestDimensionIndicesOptional=number_slider_2)  # -> _1st, _2nd, _3rd

# ----
# Unpack values from network
som_g_data = GenericSOMDisplay(CrowNet=crow_som_g.CrowNet, XYZDimensionIndicesOptional=panel_3)  # -> DataVectors, Points, AdressStructure, WinnerIndex

# ----
# Choose which items to display
number_slider_3 = Slider(1, range=0..1)
num = Number([number_slider_3, Slider(1, range=0..1), Slider(1, range=0..1), Slider(1, range=0..1)])
data_picker = GenericSOMDataPicker(DataVectors=som_g_data.DataVectors, Indices=num)  # -> DataVectors, Paths

# ----
# - unpack trained vectors to
#   rebuild parametric model
item = ListItem(List=data_picker.DataVectors, Index=0, Wrap=False)  # -> flatten(Item), flatten(Item1), flatten(Item2), flatten(Item3), flatten(Item4), flatten(Item5), flatten(Item6), flatten(Item7)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
vec_3 = VectorXYZ(XComponent=item.Item3, YComponent=item.Item4, ZComponent=item.Item5)  # -> unitize(Vector), Length
pt_2 = ConstructPoint(XCoordinate=item.Item, YCoordinate=item.Item1, ZCoordinate=item.Item2)
vec_4 = VectorXYZ(XComponent=item.Item6, YComponent=item.Item7, ZComponent=item.Item8)  # -> unitize(Vector), Length
hsl_2 = ColourHSL(Alpha=Slider(0.896, range=0..1), Hue=item.Item10, Saturation=0.6, Luminance=0.6)
pl_2 = ConstructPlane(Origin=pt_2, XAxis=vec_3.Vector, YAxis=vec_4.Vector)
box_2 = CenterBox(Base=pl_2, X=item.Item9, Y=item.Item9, Z=item.Item9)
scale = Scale(Geometry=box_2, Center=pl_2, Factor=1)  # -> Geometry, Transform

preview_2 = CustomPreview(Geometry=scale.Geometry, Shader=hsl_2)
