# Grasshopper definition 160523_Crow_Showcase_Kohonen2D.gh (Grasshopper 0.9.76)
# plug-ins: Crow

# ----
# Set up Self Organizing Map
number_slider = Slider(0.15, range=0..1)
som_2d = CrowNetConstructorSelfOrganizingMap2D(
    LayerWidth=Slider(40, range=0..100),
    LayerHeight=Slider(40, range=0..150),
    CircularRows=Toggle(False),
    CircularColumns=Toggle(False),
    LatticeTopology=Toggle(False),
    NeighborhoodFunction=Toggle(False),
    LearningRate=number_slider)

pt = Point([<point referenced from the Rhino model> x131])
plfit = PlaneFit(Points=pt)  # -> Plane, Deviation
rectangle = Rectangle(Plane=plfit.Plane, XSize=Domain(0, 9), YSize=Domain(-8, 8), Radius=0)  # -> Rectangle, Length
mplane = MeshPlane(Boundary=rectangle.Rectangle, WidthCount="60", HeightCount="40")  # -> Mesh, Area

# ----
# Restart
toggle = BooleanToggle(False)

demesh = DeconstructMesh(Mesh=mplane.Mesh)  # -> Vertices, Faces, Colours, Normals
jitter = Jitter(List=pt, Jitter=1, Seed=2)  # -> Values, Indices
partition = PartitionList(List=demesh.Vertices, Size=expr("x+1", "40"))  # -> simplify(Chunks)
crow_som_2d = CrowEngineSelfOrganizingMaps2D(TrainingCycles="500", CrowNetSOM2D=som_2d, Points=jitter.Values, TrainginVectors=partition, Go=toggle)  # -> TrainingCycles, CrowNet
som_2d_mesh = _2DSOMMeshDisplay(CrowNet=crow_som_2d.CrowNet)
som_2d_points = _2DSOMPointDisplay(CrowNet=crow_som_2d.CrowNet)  # -> AllPoints, WinnerPoints, AllValues, WinnerPath
som_2d_grid = _2DSOMGridDisplay(CrowNet=crow_som_2d.CrowNet)  # -> GridRows, GridColumns, HexagonalRows
